# Dynamo graph plotInstances.dyn "機器搬入プロット" (Dynamo 2.0.3.8810)
# ドア、窓、柱を考慮して、部屋にデスクの列を生成します。出口までの距離、外側のビューなどを計算します。

# group: 入力
family_type = FamilyTypes(index=18)  # graph input
# note: 入力
# 搬入経路線分グループ：グループ化した連続モデル線分
# Place Num：選択したモデル線分上に配置するファミリ数
# Global Rotation：全配置ファミリに適用される回転角度，いい感じに設定する
# Family Type：配置するファミリのタイプ
# note: ⒸYaGitHub
# note: I'm working on Revit 2019.2 & Dynamo 2.0.3
搬入経路線分グループ選択 = DSModelElementSelection()  # 1 picked in the model; graph input
place_num = DoubleInput(50)  # graph input
global_rotation = DoubleInput(90)  # graph input

dependend_elem_ids = Python(IN[0]=搬入経路線分グループ選択)
# ---------- dependend_elem_ids.python (32 lines) ----------
import clr

clr.AddReference('RevitAPI')
from Autodesk.Revit.DB import *
from Autodesk.Revit.DB.Structure import *

clr.AddReference('RevitAPIUI')
from Autodesk.Revit.UI import *

clr.AddReference('System')
from System.Collections.Generic import List
from System import Type

clr.AddReference('RevitNodes')
import Revit
clr.ImportExtensions(Revit.GeometryConversion)
clr.ImportExtensions(Revit.Elements)

clr.AddReference('RevitServices')
import RevitServices
from RevitServices.Persistence import DocumentManager
from RevitServices.Transactions import TransactionManager

doc = DocumentManager.Instance.CurrentDBDocument
uidoc=DocumentManager.Instance.CurrentUIApplication.ActiveUIDocument

#Preparing input from dynamo to revit
groupElem = UnwrapElement(IN[0])
dependentElems = groupElem.GetDependentElements(None)


OUT = [elem for elem in dependentElems if elem != groupElem.Id]
# ----------------------------------------
dependend_elems = Python(IN[0]=dependend_elem_ids)
# ---------- dependend_elems.python (35 lines) ----------
import clr

clr.AddReference('RevitAPI')
from Autodesk.Revit.DB import *
from Autodesk.Revit.DB.Structure import *

clr.AddReference('RevitAPIUI')
from Autodesk.Revit.UI import *

clr.AddReference('System')
from System.Collections.Generic import List
from System import Type

clr.AddReference('RevitNodes')
import Revit
clr.ImportExtensions(Revit.GeometryConversion)
clr.ImportExtensions(Revit.Elements)

clr.AddReference('RevitServices')
import RevitServices
from RevitServices.Persistence import DocumentManager
from RevitServices.Transactions import TransactionManager

doc = DocumentManager.Instance.CurrentDBDocument
uidoc=DocumentManager.Instance.CurrentUIApplication.ActiveUIDocument

#Preparing input from dynamo to revit
elemIds = UnwrapElement(IN[0])
elems = []
for elemId in elemIds:
	modelCurve = doc.GetElement(elemId)
	elems.append(modelCurve)


OUT = elems
# ----------------------------------------
curves = Element.Curves(element=dependend_elems)
flatten = List.Flatten(list=curves)
byJoinedCurves = PolyCurve.ByJoinedCurves(curves=flatten)
code_block = CodeBlock(x=place_num) { 0.0..1.0..#x; }
pointAtParameter = Curve.PointAtParameter(curve=byJoinedCurves, param=code_block)
byPoint = FamilyInstance.ByPoint(familyType=family_type, point=pointAtParameter)
法線ベクトルの取得 = Curve.NormalAtParameter(curve=byJoinedCurves, param=code_block)
法線ベクトルの補正 = Python(IN[0]=法線ベクトルの取得)
# ---------- 法線ベクトルの補正.python (26 lines) ----------
#常に回転角度が最小になるように法線ベクトルを補正する
#つまり、法線候補は常に2つあるが、直前のベクトルとの内関が1に近い方を採用する処理

# Python 標準ライブラリおよび DesignScript ライブラリをロード
import sys
import clr
clr.AddReference('ProtoGeometry')
from Autodesk.DesignScript.Geometry import *

# このノードへの入力は、リスト形式で IN 変数に格納されます。
vecs = IN[0]
new_vecs = []

# この行の下にコードを配置します
new_vecs.append(vecs[0])
for i in range(len(vecs)):
	if i != 0:
		cand_vec = Vector.Scale(vecs[i],-1)
		if vecs[i].Dot(new_vecs[i-1]) > cand_vec.Dot(new_vecs[i-1]):
			new_vecs.append(vecs[i])
		else:
			new_vecs.append(cand_vec)
		

# 出力を OUT 変数に割り当てます。
OUT = new_vecs
# ----------------------------------------
相対回転角度計算 = Python(IN[0]=法線ベクトルの補正)
# ---------- 相対回転角度計算.python (36 lines) ----------
# Python 標準ライブラリおよび DesignScript ライブラリをロード
import sys
import clr
import math
clr.AddReference('ProtoGeometry')
from Autodesk.DesignScript.Geometry import *

# このノードへの入力は、リスト形式で IN 変数に格納されます。
normals = IN[0]
std = normals[0]
rel_angles = []

# この行の下にコードを配置します
def acos_deg(x):
	if x>1:
		x=1
	if x<-1:
		x=-1
	return math.acos(x)/(2*math.pi)*360

#ひとつ前のポイントからの相対回転角度を計算
rel_angles.append(acos_deg(normals[0].Dot(normals[0])))

for i in range(len(normals)-1):
#for normal in normals:
	cross = Vector.Cross(normals[i],normals[i+1])
	if cross.Z == 0:
	 	crossdir = 1
	else:
		crossdir = cross.Z/abs(cross.Z)*(-1)
	rel_angles.append(crossdir*acos_deg(normals[i].Dot(normals[i+1])))
	#ratios.append(normal.Dot(std))


# 出力を OUT 変数に割り当てます。
OUT = rel_angles
# ----------------------------------------
python_script = Python(IN[0]=相対回転角度計算)
# ---------- python_script.python (19 lines) ----------
# Python 標準ライブラリおよび DesignScript ライブラリをロード
import sys
import clr
clr.AddReference('ProtoGeometry')
from Autodesk.DesignScript.Geometry import *

# このノードへの入力は、リスト形式で IN 変数に格納されます。
angles = IN[0]
sum_angle = 0
sum_angles = []

# この行の下にコードを配置します
for angle in angles:
	sum_angle += angle
	sum_angles.append(sum_angle)


# 出力を OUT 変数に割り当てます。
OUT = sum_angles
# ----------------------------------------
attach_grobal_rotation = python_script + global_rotation
setRotation = FamilyInstance.SetRotation(familyInstance=byPoint, degree=attach_grobal_rotation)
